# Grasshopper definition Sara_Parametric Vase.gh (Grasshopper 1.0.7)

# ----
# Spine Geo
number_slider = Slider(12.288, range=0..100)
range = Range(Domain=Domain(0, 1), Steps=number_slider)
pt = ConstructPoint(XCoordinate=Slider(0, range=0..100), YCoordinate=Slider(0, range=0..100), ZCoordinate=Slider(7.059, range=0..100))
graph = GraphMapper(
    range,
    x0=0,
    x1=1,
    y0=0,
    y1=1,
    container_name="Bezier",
    cpx=[0, 0.2865433991, 0.241366297, 1],
    cpy=[0.3078724146, 0.4772865772, 0.8403181434, 0.1868619323])
line = LineSDL(Start=pt, Direction=Vector(0, 0, 1), Length=Slider(53.8, range=0..100))
expression = Expression(x=graph, y=Slider(40.948, range=0..100), Expression="x * y")
divide = DivideCurve(Curve=line, Count=number_slider, Kinks=False)  # -> Points, Tangents, Parameters

multiplication = Multiplication(A=graph, B=Slider(0.852, range=0..100))

# ----
# Circles
circle = CircleCNR(Center=divide.Points, Normal=Vector(0, 0, 1), Radius=expression)
seam = Seam(Curve=reparameterize(circle), Seam=multiplication)
divide_2 = DivideCurve(Curve=seam, Count=Slider(66, range=0..100), Kinks=False)  # -> simplify(Points), Tangents, Parameters

# ----
# Pattern gen
dispatch = Dispatch(List=divide_2.Points, DispatchPattern=[True, False])  # -> simplify(ListA), simplify(ListB)
vec2pt = Vector2Pt(PointA=dispatch.ListB, PointB=simplify(graft(circle)), Unitize=False)  # -> Vector, Length
amp = Amplitude(Vector=vec2pt.Vector, Amplitude=Slider(1.967, range=0..100))
move = Move(Geometry=dispatch.ListB, Motion=amp)  # -> Geometry, Transform
weave = Weave(Pattern=[0, 1], Stream0=dispatch.ListA, Stream1=move.Geometry, NullGaps=False)  # -> simplify(Weave)

# ----
# Brep Gen
pline = PolyLine(Vertices=weave, Closed=True)
loft = Loft(Curves=flatten(pline), Options={Adjust=False, Closed=False, LoftEnds=0, LoftSimp=0, LoftType=0, Rebuild=10, Refit=0.01})
cap = CapHoles(Brep=loft)
